# Grasshopper definition MARA_CAD_quaternion_source.gh (Grasshopper 1.0.8)

pipeline = GeometryPipeline(
    GroupByLayer=False,
    GroupByType=False,
    IncludeHidden=True,
    IncludeLocked=True,
    LayerFilter="bricks",
    NameFilter="*",
    SublayerFiltering=True,
    TypeFilter=1073741848)
pipeline_2 = GeometryPipeline(
    GroupByLayer=False,
    GroupByType=False,
    IncludeHidden=True,
    IncludeLocked=True,
    LayerFilter="FIDUCIARY",
    NameFilter="*",
    SublayerFiltering=True,
    TypeFilter=4)
volume = Volume(Geometry=pipeline)  # -> Volume, Centroid
pdecon = Deconstruct(Point=volume.Centroid)  # -> XComponent, YComponent, ZComponent
pcen = PolygonCenter(Polyline=pipeline_2)  # -> CenterV, CenterE, CenterA
sort = SortList(Keys=pdecon.XComponent, ValuesA=pipeline)  # -> Keys, ValuesA
volume_2 = Volume(Geometry=sort.ValuesA)  # -> Volume, Centroid
pdecon_2 = Deconstruct(Point=volume_2.Centroid)  # -> XComponent, YComponent, ZComponent
sort_2 = SortList(Keys=pdecon_2.ZComponent, ValuesA=sort.ValuesA)  # -> Keys, ValuesA
debrep = DeconstructBrep(Brep=sort_2.ValuesA)  # -> Faces, Edges, Vertices
evalsrf = EvaluateSurface(Surface=reparameterize(debrep.Faces), Point="0.5,0.5")  # -> Point, Normal, UDirection, VDirection, Frame
pdecon_3 = Deconstruct(Point=evalsrf.Point)  # -> XComponent, YComponent, ZComponent
sort_3 = SortList(Keys=pdecon_3.ZComponent, ValuesA=evalsrf.Frame)  # -> Keys, ValuesA
item = ListItem(List=sort_3.ValuesA, Index=0, Wrap=True)  # -> simplify(flatten(Item))
pln = Plane(item)

# ---- group: SORT BY X
pt = Point(item)
# Without the Human Components
pdecon_4 = Deconstruct(Point=pt)  # -> XComponent, YComponent, ZComponent
sort_4 = SortList(Keys=pdecon_4.ZComponent, ValuesA=pln)  # -> Keys, ValuesA

# ----
deplane = DeconstructPlane(Plane=pln)  # -> Origin, XAxis, YAxis, ZAxis
pln_2 = Plane(sort_4.ValuesA)
number_slider = Slider(1, range=0..10)
panel = Panel("""12
14""")
toggle = BooleanToggle(False)

# ---- group: SPLIT BY X
pt_2 = Point(sort_4.ValuesA)
pdecon_5 = Deconstruct(Point=pt_2)  # -> XComponent, YComponent, ZComponent
graft = GraftTree(Tree=pln_2, IncludeEmptyLists=True, IncludeNullItems=True)
tstat = TreeStatistics(Tree=graft)  # -> Paths, Length, Count

# ----
int = Integer(pdecon_5.ZComponent)

# ---- group: SPLIT BY X (continued)
cset = CreateSet(List=int)  # -> Set, graft(Map)
path = ConstructPath(Indices=cset.Map)
replace = ReplacePaths(Data=graft, Search=tstat.Paths, Replace=flatten(path))

# ----
pln_3 = Plane(replace)

# ---- group: SORT BY Y
pt_3 = Point(replace)
pdecon_6 = Deconstruct(Point=pt_3)  # -> XComponent, YComponent, ZComponent
sort_5 = SortList(Keys=pdecon_6.YComponent, ValuesA=pln_3)  # -> Keys, ValuesA

# ----
pln_4 = Plane(sort_5.ValuesA)
pt_4 = Point(sort_5.ValuesA)

# ---- group: SORT BY Y in each branch
pdecon_7 = Deconstruct(Point=pt_4)  # -> XComponent, YComponent, ZComponent
tstat_2 = TreeStatistics(Tree=pln_4)  # -> Paths, Length, Count
graft_2 = GraftTree(Tree=pln_4, IncludeEmptyLists=True, IncludeNullItems=True)
cset_2 = CreateSet(List=pdecon_7.YComponent)  # -> Set, Map
tstat_3 = TreeStatistics(Tree=graft_2)  # -> Paths, Length, Count
dpath = DeconstructPath(Branch=tstat_2.Paths)
lng = ListLength(List=cset_2.Map)
dup = DuplicateData(Data=dpath, Number=lng, Order=True)  # -> simplify(graft(Data))
merge = Merge(Data1=dup, Data2=simplify(graft(cset_2.Map)))
path_2 = ConstructPath(Indices=merge)
replace_2 = ReplacePaths(Data=graft_2, Search=tstat_3.Paths, Replace=flatten(path_2))

# ----
pln_5 = Plane(replace_2)

# ---- group: SORT BY Z
pt_5 = Point(replace_2)
pdecon_8 = Deconstruct(Point=pt_5)  # -> XComponent, YComponent, ZComponent
sort_6 = SortList(Keys=pdecon_8.ZComponent, ValuesA=pln_5)  # -> Keys, flatten(ValuesA)

# ----
pln_6 = Plane(sort_5.ValuesA)
deplane_2 = DeconstructPlane(Plane=pln_6)  # -> Origin, XAxis, YAxis, ZAxis
line = LineSDL(Start=deplane_2.Origin, Direction=deplane_2.XAxis, Length=Slider(100, range=0..100))
end = EndPoints(Curve=line)  # -> Start, End
pdecon_9 = Deconstruct(Point=end.End)  # -> XComponent, YComponent, ZComponent
pdecon_10 = Deconstruct(Point=end.Start)  # -> XComponent, YComponent, ZComponent
panel_2 = Panel(pln_6)
subtraction = Subtraction(A=pdecon_10.YComponent, B=pdecon_9.YComponent)
larger = LargerThan(FirstNumber=subtraction, SecondNumber="0")  # -> LargerThan, OrEqualTo
sift = SiftPattern(List=pln_6, SiftPattern=larger.LargerThan)  # -> Output0, Output1
prot = RotatePlane(Plane=sift.Output1, Angle="pi")
pln_7 = Plane(sift.Output0)
combine = CombineData(Input0=pln_7, Input1=prot)  # -> flatten(Result), Index
rev = ReverseList(List=combine.Result)
item_2 = ListItem(List=rev, Index=Slider(14, range=0..100), Wrap=True)
item_3 = ListItem(List=rev, Index=panel, Wrap=True)
cull_i = CullIndex(List=rev, Indices=panel, Wrap=True)
item_4 = ListItem(List=item_3, Index=1, Wrap=True)  # -> Item2, Item1, Item
ins = InsertItems(List=cull_i, Item=item_4.Item1, Indices="7", Wrap=False)
ins_2 = InsertItems(List=ins, Item=item_4.Item, Indices="7", Wrap=False)
bricks_to_json = Python3Script(TAG=pcen.CenterV, FRAMES=ins_2, PATH="C:\MARA_1\MARA_ws\runs\run_13_lecture_hall\source.json", WRITE=Button())  # -> OUTPATH, COUNT; inputs TAG: Point3d, FRAMES: list of Plane, PATH: String, WRITE: Boolean
# ---------- bricks_to_json: Python ----------
"""Export brick frames (planes) relative to a tag point to JSON rows of [x, y, z, yaw_deg].

Notes
-----
- Inputs (Grasshopper):
    WRITE : bool          -> trigger file write when True
    PATH  : str           -> file path to write JSON
    TAG   : Rhino.Geometry.Point3d (tag origin point)
    FRAMES: list[Rhino.Geometry.Plane] (one per brick)

- Coordinate mapping matches your previous point-based script so +X(fiducial) aligns
  with +Y(world), and +Y(fiducial) aligns with -X(world). Specifically:
      x_rel = (origin.Y - TAG.Y) / 1000
      y_rel = (TAG.X   - origin.X) / 1000
      z_rel = (origin.Z - TAG.Z) / 1000
  i.e., a +90° rotation of world XY into the fiducial XY.

- Yaw is computed from each frame’s X-axis, projected to XY, then expressed in the
  fiducial frame using the same mapping:
      v_tag = (v_world.y, -v_world.x)
      yaw = atan2(v_tag.y, v_tag.x) in degrees, normalized to [-180, 180].
"""

import json, os, math

OUTPATH = ""
COUNT = 0

def _normalize_angle_deg(a):
    """Wrap angle to [-180, 180] degrees."""
    a = (a + 180.0) % 360.0 - 180.0
    return a

def _world_vec_to_tag_xy(vx, vy):
    """Map a 2D world XY vector into fiducial/tag XY using the same convention as positions:
       x_tag = +vy, y_tag = -vx
    """
    return (vy, -vx)

if WRITE:
    # --- Validate inputs ---
    if not PATH or not isinstance(PATH, str):
        raise ValueError("PATH must be a valid string file path, e.g. C:\\\\MARA_1\\\\data\\\\wall_with_angles.json")
    if TAG is None:
        raise ValueError("TAG point is required.")
    if not FRAMES:
        raise ValueError("FRAMES list is empty (expecting Rhino planes for each brick).")

    # --- Ensure folder exists ---
    folder = os.path.dirname(PATH)
    if folder and not os.path.exists(folder):
        os.makedirs(folder)

    data = []
    for i, pl in enumerate(FRAMES):
        # Safety: ensure we have a plane-like object with Origin/XAxis/YAxis
        if not hasattr(pl, "Origin") or not hasattr(pl, "XAxis"):
            raise TypeError("FRAMES[%d] is not a Rhino.Geometry.Plane (missing Origin/XAxis)." % i)

        o = pl.Origin
        # Position relative to TAG in fiducial (jaw) axes, meters (mm -> m)
        x_rel = (o.Y - TAG.Y) / 1000.0
        y_rel = (TAG.X - o.X) / 1000.0
        z_rel = (o.Z - TAG.Z) / 1000.0

        # Yaw from the frame's X-axis (project to XY)
        xaxis = pl.XAxis
        # Extract XY components
        vx_w = float(xaxis.X)
        vy_w = float(xaxis.Y)
        # If nearly zero in XY, fall back to plane.YAxis to avoid undefined yaw
        if abs(vx_w) + abs(vy_w) < 1e-9 and hasattr(pl, "YAxis"):
            vx_w = float(pl.YAxis.X)
            vy_w = float(pl.YAxis.Y)

        # Map world XY vector to fiducial XY using same convention as positions
        vx_tag, vy_tag = _world_vec_to_tag_xy(vx_w, vy_w)

        # Compute yaw (deg) and normalize
        yaw_deg = math.degrees(math.atan2(vy_tag, vx_tag))
        yaw_deg = _normalize_angle_deg(yaw_deg)

        # Append rounded values
        data.append([
            round(x_rel, 3),
            round(y_rel, 3),
            round(z_rel, 3),
            round(yaw_deg, 1)
        ])

    # --- Write JSON ---
    with open(PATH, "w") as f:
        json.dump(data, f, indent=2)

    OUTPATH = PATH
    COUNT = len(data)
# ---------- end bricks_to_json ----------
panel_3 = Panel(bricks_to_json.OUTPATH)
panel_4 = Panel(bricks_to_json.COUNT)
panel_5 = Panel(sort_5.ValuesA)
item_5 = ListItem(List=ins_2, Index=Slider(65, range=0..100), Wrap=True)
